# Grasshopper definition test_file.gh (Grasshopper 1.0.7)

height = Slider(2250, range=1700..3000)
python = GhPythonScript()  # -> out, nodes, edges
# ---------- python: Python ----------
__author__ = "bdoherty"
__version__ = "2024.08.27"

import rhinoscriptsyntax as rs

import Grasshopper as gh
import Grasshopper.Kernel as ghk
import Grasshopper.Kernel.Data as ghkd
import Grasshopper.Kernel.Types as ghkt
#from future import print_function

def traverse_grasshopper_graph():
    # Get the active Grasshopper document
    gh_doc = gh.Instances.ActiveCanvas.Document

    # Dictionary to store nodes and edges
    nodes = {}
    edges = []

    # Iterate through all objects in the document
    for obj in gh_doc.Objects:
        if isinstance(obj, ghk.IGH_Component):
            # Add node
            node_id = obj.InstanceGuid.ToString()
            nodes[node_id] = {
                "name": obj.Name,
                "inputs": [],
                "outputs": [],
                "value": None,  # Placeholder for node value
            }
            

            # Iterate through input parameters
            for input_param in obj.Params.Input:
                for source in input_param.Sources:
                    if source.Attributes != None:
                        if source.Attributes.Parent != None:
                            source_id = source.Attributes.Parent.InstanceGuid.ToString()
                            nodes[node_id]["inputs"].append(source_id)
                            edges.append((source_id, node_id))

            # Iterate through output parameters
            for output_param in obj.Params.Output:
                for recipient in output_param.Recipients:
                    if recipient.Attributes != None:
                        if recipient.Attributes.Parent != None:
                            recipient_id = recipient.Attributes.Parent.InstanceGuid.ToString()
                            nodes[node_id]["outputs"].append(recipient_id)
                            edges.append((node_id, recipient_id))

    return nodes, edges


# Example usage
nodes, edges = traverse_grasshopper_graph()

print("Nodes:", nodes)
node_names = {}
for k,v in nodes.items():
    node_names[k] = v["name"].replace(" ","_") +"\n"+ k
print("node_names", node_names)
nodes = node_names.values()

new_edges = []
for e in edges:
    new_edges.append("\""+node_names[e[0]]+"\"" + " -> " + "\""+node_names[e[1]]+"\"")
edges = new_edges
print("Edges:", new_edges)
# ---------- end python ----------
small_angle = Number(85.4)
big_angle = Number(105)
crv = Curve(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)
panel = Panel(big_angle)
panel_2 = Panel(small_angle)
flip = FlipCurve(Curve=crv)  # -> Curve, Flag
panel_3 = Panel(python.nodes)
panel_4 = Panel(python.edges)
rad = Radians(Degrees=big_angle)
rad_2 = Radians(Degrees=small_angle)
line = Line(flip.Curve)
vec = Vector(line)
b = B(height=height, angle=rad)
b_2 = B(height=height, angle=rad_2)
amp = Amplitude(Vector=vec, Amplitude=height)
end = EndPoints(Curve=line)  # -> Start, End
move = Move(Geometry=end.Start, Motion=amp)  # -> Geometry, Transform
xy = XYPlane(Origin=move.Geometry)
ellipse = Ellipse(Plane=xy, Radius1=b, Radius2=b_2)  # -> Ellipse, Focus1, Focus2

# ==== cluster B
height = ClusterInput()
angle = ClusterInput()
b = GhPythonScript(height=height, angle=angle)  # -> base
# ---------- b: Python ----------
__author__ = "bdoherty"
__version__ = "2024.06.06"

#import rhinoscriptsyntax as rs
import math

hyp = height/math.cos(angle/2)

base = math.sqrt(hyp**2 - height**2)

a = base
# ---------- end b ----------
base = ClusterOutput(b)
